# Grasshopper definition evaluate.gh (Grasshopper 1.0.7)
# plug-ins: Portal, Vox, Heteroptera

trigger = Trigger(Interval=-1, TimerInterval=5, Target=[file_2, file])  # disabled
path = FilePath("F:\lab\3d-autoencoder\data\inference\output\inference_output_thresholded.json")
path_2 = FilePath("F:\lab\3d-autoencoder\data\inference\input\inference")
file = FileReader(FilePath=path)

# ---- group: Volume
box = Box({Plane=PlaneXY(0, 0, 0), X=Domain(-27.04713456, 42.93584143), Y=Domain(-23.45763848, 41.88845835), Z=Domain(0.01075653027, 62.99229233)})
center = Center(Geometry=box)  # -> Center, Dimension
scale = Scale(Geometry=box, Center=center.Center, Factor=Slider(1.5, range=0..10))  # -> Geometry, Transform

# ----
file_2 = FileReader(FilePath=path_2)
# Normalize
# Normalize
# Normalize
# Normalize
# Normalize
# Normalize
number_slider = Slider(5, range=0..10)
deb = BytesDecoder(Bytes=file)
number_slider_2 = Slider(5, range=0..10)
deb_2 = BytesDecoder(Bytes=file_2)
write = Button()
nickname = DeserializeVoxels(VStr=deb_2)  # -> Voxels, VoxelSize, States
vec = VectorXYZ(XComponent=number_slider, YComponent=number_slider, ZComponent=number_slider)  # -> Vector, Length
vec_2 = VectorXYZ(XComponent=number_slider_2, YComponent=number_slider_2, ZComponent=number_slider_2)  # -> Vector, Length
nickname_2 = DeserializeVoxels(VStr=deb)  # -> Voxels, VoxelSize, States
filter = VoxelFilter(VoxelPos=nickname.Voxels, VoxelSize=nickname.VoxelSize, States=nickname.States, TargetState=1)  # -> VoxelPos, VoxelSize
filter_2 = VoxelFilter(VoxelPos=nickname_2.Voxels, VoxelSize=nickname_2.VoxelSize, States=nickname_2.States, TargetState=1)  # -> VoxelPos, VoxelSize
lng = ListLength(List=filter.VoxelPos)
lng_2 = ListLength(List=filter_2.VoxelPos)
dup = DuplicateData(Data=vec.Vector, Number=lng, Order=True)
dup_2 = DuplicateData(Data=vec_2.Vector, Number=lng_2, Order=True)
python = GhPythonScript(x=filter_2.VoxelPos, y=filter.VoxelPos)  # -> out, a; inputs x: list of Point3d, y: list of Point3d
# ---------- python: Python ----------
import rhinoscriptsyntax as rs

match_count = 0

for x1 in x:
    for y1 in y:
        if x1 == y1:
            match_count+=1
ratio = match_count / len(x) * 100
a = str(ratio) + "%"
# ---------- end python ----------
match_rate = Panel(python.a)
voxmesh = VoxelMesher(VoxelPos=filter.VoxelPos, VoxelSize=dup, Algorithm=Slider(1, range=0..10))
voxmesh_2 = VoxelMesher(VoxelPos=filter_2.VoxelPos, VoxelSize=dup_2, Algorithm=Slider(1, range=0..10))
panel = Panel("grid_22x20x20")
preview = CustomPreview(Geometry=voxmesh_2, Material=ColourSwatch(SwatchColor=RGB(115, 147, 255)))
preview_2 = CustomPreview(Geometry=voxmesh, Material=ColourSwatch(SwatchColor=RGB(255, 164, 115)))

# ----
# Evaluate with new geometry
subd = SubD(<subd referenced from the Rhino model>)
number_slider_3 = Slider(5, range=0..10)
meshsubd = MeshFromSubD(SubD=subd, Density=2)
mesh = Mesh(meshsubd)
vec_3 = VectorXYZ(XComponent=number_slider_3, YComponent=number_slider_3, ZComponent=number_slider_3)  # -> Vector, Length
box_2 = Box(scale.Geometry)
path_3 = FilePath("F:\lab\3d-autoencoder\data\inference\input\")
concat = Concatenate(FragmentA=path_3, FragmentB="inference")

voxelsh = VoxelizeMeshSH(Mesh=mesh, VoxelSize=vec_3.Vector, Bounds=box_2)
serializevoxelgrid = SerializeVoxelGrid(VoxelGrid=voxelsh, ExtractParts=Slider(0, range=0..10))  # -> Serialized1D, Serialized3D
concat_2 = Concatenate(FragmentA=path_3, FragmentB="inference", FragmentC="_3d")
file_3 = FileWriter(Bytes=serializevoxelgrid.Serialized3D, FilePath=concat_2, Write=write)

file_4 = FileWriter(Bytes=serializevoxelgrid.Serialized1D, FilePath=concat, Write=write)
